# Grasshopper definition main.gh (Grasshopper 1.0.7)
# plug-ins: Human UI, Human, Hops

trigger = Trigger(Interval=-5000, TimerInterval=5000, Target=save_viewport_to_file)  # disabled
boolean_toggle = BooleanToggle(True)

env = Panel("conda activate invokeai")
script = Panel("python scripts\invoke.py --socket")
default_options = Panel("""-n1
-v0.5
-g""")
strength = Slider(0.7, range=0.1..0.95)
iterations = Slider(30, range=1..75)
image_size = Slider(550, range=550..2000)
tags = Panel("""modernist
brutalist
Vienna
Newyork
Shanghai
Photography""")
get_gh_filepath = CSharpScript()  # -> A
# ---------- get_gh_filepath: C# ----------
A = GrasshopperDocument.FilePath;
# ---------- end get_gh_filepath ----------
ghpython_script = GhPythonScript(x=get_gh_filepath)  # -> a
# ---------- ghpython_script: Python ----------
__author__ = "DueringS"
__version__ = "2022.10.09"

import rhinoscriptsyntax as rs

temp = x.split("\\")[-1]
a = x.replace(temp, "")
print a
# ---------- end ghpython_script ----------
concatenate = Concatenate(FragmentA=ghpython_script, FragmentB="stable-diffusion")
panel = Panel(concatenate)
create_slider = CreateSlider(Slider=strength, ShowBounds=False, ShowTicks=False, ShowTooltip=False, ShowValLabel=True, showLabel=True)
create_slider_2 = CreateSlider(Slider=iterations, ShowBounds=False, ShowTicks=False, ShowTooltip=False, ShowValLabel=True, showLabel=True)
create_slider_3 = CreateSlider(Slider=image_size, ShowBounds=False, ShowTicks=False, ShowTooltip=False, ShowValLabel=True, showLabel=True)
create_button = CreateButton(ButtonName="copy", ButtonStyle=0)
create_text_box = CreateTextBox(Label="viewport name", DefaultText="Perspective", UpdateButton=True, showLabel=True)
create_text_box_2 = CreateTextBox(Label="path to stable-diffusion folder", DefaultText=panel, UpdateButton=True, showLabel=True)
create_text_box_3 = CreateTextBox(Label="prompt", DefaultText="a space cow is grazing on the moon", UpdateButton=True, showLabel=True)
create_button_2 = CreateButton(ButtonName="update image", ButtonStyle=0)
create_toggle = CreateToggle(Default=False, Label=tags, OnLabel="    ", OffLabel="    ")
concatenate_2 = Concatenate(FragmentA=ghpython_script, FragmentB="stableDiffusionSocket.gh")
value_listener = ValueListener(Elements=create_slider_2, SomeProperty=True)  # -> Values, Indices
create_stack = CreateStack(UIElements=[create_slider, create_slider_2], Horizontal=False)
concatenate_3 = Concatenate(FragmentA=ghpython_script, FragmentB="RhinoLive.png")
ghpython_script_2 = GhPythonScript(x=tags)  # -> a
# ---------- ghpython_script_2: Python ----------
__author__ = "DueringS"
__version__ = "2022.10.13"

import rhinoscriptsyntax as rs
if x == "Photography":
    a = "Nikon, Canon"
else:
   a = x
# ---------- end ghpython_script_2 ----------
value_listener_2 = ValueListener(Elements=create_slider_3, SomeProperty=True)  # -> Values, Indices
value_listener_3 = ValueListener(Elements=create_slider, SomeProperty=True)  # -> Values, Indices
value_listener_4 = ValueListener(Elements=create_button, SomeProperty=True)  # -> Values, Indices
ghpython_script_3 = GhPythonScript(x=[value_listener_2.Values, value_listener_4.Values])  # -> a
# ---------- ghpython_script_3: Python ----------
__author__ = "DueringS"
__version__ = "2022.10.13"

import rhinoscriptsyntax as rs

a = True
# ---------- end ghpython_script_3 ----------
list_item = ListItem(List=ghpython_script_3, Index=0, Wrap=True)
viewport_properties = ViewportProperties(Update=list_item, AutoUpdate=False)  # -> ViewportNames, ActiveViewportIndex, ViewportBounds, ViewportDisplayMode, CameraLocation, CameraTarget, CameraPlane, CameraLensLength, CameraProjection, CameraUp
value_listener_5 = ValueListener(Elements=create_text_box_2, SomeProperty=True)  # -> Values, Indices
ghpython_script_4 = GhPythonScript(stPath=value_listener_5.Values)  # -> flatten(a)
# ---------- ghpython_script_4: Python ----------
__author__ = "DueringS"
__version__ = "2022.10.09"

import rhinoscriptsyntax as rs

a = "CD " + stPath
# ---------- end ghpython_script_4 ----------
merge = Merge(Data1=env, Data2=ghpython_script_4, Data3=script)
value_listener_6 = ValueListener(Elements=create_text_box_3, SomeProperty=True)  # -> flatten(Values), Indices
value_listener_7 = ValueListener(Elements=create_button_2, SomeProperty=True)  # -> Values, Indices
value_listener_8 = ValueListener(Elements=create_text_box, SomeProperty=True)  # -> Values, Indices
value_listener_9 = ValueListener(Elements=create_toggle, SomeProperty=True)  # -> flatten(Values), Indices
data_dam = DataDam(DataDataA=value_listener_3.Values, BufferDelay=20000000, BufferMode=2)
data_dam_2 = DataDam(DataDataA=value_listener_2.Values, BufferDelay=20000000, BufferMode=2)
ghpython_script_5 = GhPythonScript(
    pxSize=data_dam_2,
    name=value_listener_8.Values,
    names=viewport_properties.ViewportNames,
    bds=viewport_properties.ViewportBounds)  # -> factor; inputs names: list, bds: list of Rectangle3d
# ---------- ghpython_script_5: Python ----------
__author__ = "DueringS"
__version__ = "2022.10.09"

import rhinoscriptsyntax as rs

for i, n in enumerate(names):
    if n == name:
        aa = pxSize / bds[i].Width
        factor = round(aa,1)
# ---------- end ghpython_script_5 ----------
save_viewport_to_file = SaveViewportToFile(
    Run=value_listener_7.Values,
    ViewportName=value_listener_8.Values,
    Render=False,
    FilePath=concatenate_3,
    ScaleFactor=ghpython_script_5)

# ---- group: preview anaconda command
tb = CreateTextBlock(Text="command", TextSize=12, Justification=0)
copytexttoclipboard = CSharpScript(x=flatten(merge), y=value_listener_4.Values)  # -> out, A; inputs x: list of String
# ---------- copytexttoclipboard: C# usings ----------
using System.Windows.Forms;
# ---------- copytexttoclipboard: C# ----------
    string newText = "";
    for (int i = 0; i < x.Count; i++)
    {
      newText += x[i];
      newText += System.Environment.NewLine;
    }
    System.Windows.Forms.Clipboard.SetText(newText);
    A = newText;
# ---------- end copytexttoclipboard ----------
settextblock = SetTextBlockContents(TextBlockToModify=tb, NewTextBlockContents=copytexttoclipboard.A)

# ----
ghpython_script_6 = GhPythonScript(prompt=value_listener_6.Values, txt=ghpython_script_2, state=value_listener_9.Values)  # -> a; inputs txt: list, state: list
# ---------- ghpython_script_6: Python ----------
__author__ = "DueringS"
__version__ = "2022.10.09"

import rhinoscriptsyntax as rs

promptFinal = prompt

for i, t in enumerate(txt):
    if state[i] == True:
        promptFinal += ", " + t

a = promptFinal
# ---------- end ghpython_script_6 ----------
merge_2 = Merge(Data1=tb, Data2=create_button)
ghpython_script_7 = GhPythonScript(y=save_viewport_to_file)  # -> flatten(a)
# ---------- ghpython_script_7: Python ----------
__author__ = "DueringS"
__version__ = "2022.10.11"

import rhinoscriptsyntax as rs
import random


a = int(random.randint(0,9999999))
# ---------- end ghpython_script_7 ----------

# ---- group: add iterations apram,
concatenate_4 = Concatenate(FragmentA="-s", FragmentB=value_listener.Values)
merge_3 = Merge(Data1=flatten(default_options), Data2=flatten(concatenate_4))

# ----
create_stack_2 = CreateStack(UIElements=merge_2, Horizontal=True)
create_separator = CreateSeparator(Thickness=0.5, Horizontal=True, Color=RGB(0, 0, 0), Width=300, Height=20)
create_label = CreateLabel(LabelText="open an anaconda prompt and paste", LabelSize=12, Justification=1)
list_item_2 = ListItem(List=flatten(ghpython_script_7), Index=0, Wrap=True)
adjust_element_positioning = AdjustElementPositioning(ElementsToAdjust=create_stack_2, AbsolutePositioning=False, HorizontalAlignment=1)
create_wrappanel = CreateWrapPanel(UIElements=create_toggle, Horizontal=True)
merge_4 = Merge(Data1=create_button_2)
hops = Hops(
    _Path=concatenate_2,
    Prompt=ghpython_script_6,
    Seed=Slider(99, range=0..9999),
    ImgPath=save_viewport_to_file,
    ModelOptions=merge_3,
    Strength=data_dam,
    HopsTrigger=list_item_2,
    CacheResultsInMemory=False,
    CacheSolveResults=False,
    RemoteDefinitionLocation="C:\Users\dueringS\ProjekteWS\StableDiffusion-Grasshopper\stableDiffusionSocket.gh",
    RemoteSolveVersion=(0, 1, 0),
    ShowInput_Enabled=False,
    ShowInput_Path=True,
    SynchronousSolve=False)
merge_5 = Merge(
    Data2=create_slider_3,
    Data3=create_text_box,
    Data4=create_text_box_2,
    Data5=create_separator,
    Data6=create_stack_2,
    Data7=create_label)
create_stack_3 = CreateStack(UIElements=merge_4, Horizontal=True)
create_view_box = CreateViewBox(UIElements=create_wrappanel, Width=350, Height=60)
panel_2 = Panel(hops)

data_recorder = DataRecorder(hops, DataLimit=1, RecordData=True)
concatenate_5 = Concatenate(A=value_listener_5.Values, Fragment_A="\", Fragment_B=data_recorder)
create_image = CreateImage(ImageSource="asd", ImageWidth=600, ImageHeight=400)

set_image = SetImage(ImageToModify=create_image, NewImagePath=concatenate_5)
adjust_element_appearance = AdjustElementAppearance(ElementsToAdjust=merge_5, Foreground=RGB(0, 0, 0), Background=RGB(255, 255, 255), FontSize=12)
merge_6 = Merge(
    Data2=flatten(create_text_box_3),
    Data3=flatten(create_stack),
    Data4=flatten(create_view_box),
    Data5=flatten(create_image),
    Data6=flatten(merge_4))
panel_3 = Panel("""model
settings""")
tabbed_view = TabbedView(TabNames=panel_3, TabTextSize=12, Tab0=flatten(merge_6), Tab1=flatten(merge_5))

launch_window = LaunchWindow(Show=Toggle(True), Name="Stable Diffusion", Width=450, Height=600, ChildStatus=0, EnableHorizScroll=False)
add_elements = AddElements(Window=launch_window, Elements=flatten(tabbed_view), DoVLChecking=True)  # -> AddedElements, ElementNames

set_window_properties = SetWindowProperties(Window=launch_window, ShowTitleBar=Toggle(True), ScaleFactor=1)
loadbm = GhPythonScript()  # -> bitmap
# ---------- loadbm: Python ----------
__author__ = "DueringS"
__version__ = "2021.08.19"

import rhinoscriptsyntax as rs
import System.Drawing.Bitmap as bm

bitmap = bm(imgPath)
# ---------- end loadbm ----------
