# Grasshopper definition main_iInfill.gh (Grasshopper 1.0.7)
# plug-ins: Human UI, Human, Hops, AviaryMacawGH

trigger = Trigger(Interval=-5000, TimerInterval=5000)  # disabled
boolean_toggle = BooleanToggle(True)

script = Panel("python scripts\dream.py --socket")
default_options = Panel("""-n1
-v0.5
-g""")
strength = Slider(0.7, range=0.1..0.95)
iterations = Slider(30, range=1..75)
image_size = Slider(550, range=550..2000)
tags = Panel("""modernist
brutalist
Vienna
Newyork
Shanghai
Photography""")
get_gh_filepath = CSharpScript()  # -> A
# ---------- get_gh_filepath: C# ----------
A = GrasshopperDocument.FilePath;
# ---------- end get_gh_filepath ----------
env = Panel("conda activate invokeai")
ghpython_script = GhPythonScript(x=get_gh_filepath)  # -> a, b
# ---------- ghpython_script: Python ----------
__author__ = "DueringS"
__version__ = "2022.10.09"

import rhinoscriptsyntax as rs

temp = x.split("\\")[-1]
a = x.replace(temp, "")
b = a[:-1]
# ---------- end ghpython_script ----------
create_text_box = CreateTextBox(Label="viewport name", DefaultText="Perspective", UpdateButton=True, showLabel=True)
create_text_box_2 = CreateTextBox(Label="path to stable-diffusion folder", DefaultText="...", UpdateButton=True, showLabel=True)
create_text_box_3 = CreateTextBox(Label="prompt", DefaultText="a space cow is grazing on the moon", UpdateButton=True, showLabel=True)
create_button = CreateButton(ButtonName="update image", ButtonStyle=0)
create_slider = CreateSlider(Slider=strength, ShowBounds=False, ShowTicks=False, ShowTooltip=False, ShowValLabel=True, showLabel=True)
create_slider_2 = CreateSlider(Slider=iterations, ShowBounds=False, ShowTicks=False, ShowTooltip=False, ShowValLabel=True, showLabel=True)
create_slider_3 = CreateSlider(Slider=image_size, ShowBounds=False, ShowTicks=False, ShowTooltip=False, ShowValLabel=True, showLabel=True)
create_button_2 = CreateButton(ButtonName="copy", ButtonStyle=0)
create_toggle = CreateToggle(Default=False, Label=tags, OnLabel="    ", OffLabel="    ")
concatenate = Concatenate(FragmentA=ghpython_script.a, FragmentB="RhinoLive.png")
concatenate_2 = Concatenate(FragmentA=ghpython_script.a, FragmentB="stableDiffusionSocket.gh")
value_listener = ValueListener(Elements=create_slider_2, SomeProperty=True)  # -> Values, Indices
create_stack = CreateStack(UIElements=[create_slider, create_slider_2], Horizontal=False)
ghpython_script_2 = GhPythonScript(x=tags)  # -> a
# ---------- ghpython_script_2: Python ----------
__author__ = "DueringS"
__version__ = "2022.10.13"

import rhinoscriptsyntax as rs
if x == "Photography":
    a = "Nikon, Canon"
else:
   a = x
# ---------- end ghpython_script_2 ----------
value_listener_2 = ValueListener(Elements=create_slider_3, SomeProperty=True)  # -> Values, Indices
value_listener_3 = ValueListener(Elements=create_slider, SomeProperty=True)  # -> Values, Indices
value_listener_4 = ValueListener(Elements=create_button_2, SomeProperty=True)  # -> Values, Indices
ghpython_script_3 = GhPythonScript(x=[value_listener_2.Values, value_listener_4.Values])  # -> a
# ---------- ghpython_script_3: Python ----------
__author__ = "DueringS"
__version__ = "2022.10.13"

import rhinoscriptsyntax as rs

a = True
# ---------- end ghpython_script_3 ----------
list_item = ListItem(List=ghpython_script_3, Index=0, Wrap=True)
viewport_properties = ViewportProperties(Update=list_item, AutoUpdate=False)  # -> ViewportNames, ActiveViewportIndex, ViewportBounds, ViewportDisplayMode, CameraLocation, CameraTarget, CameraPlane, CameraLensLength, CameraProjection, CameraUp
value_listener_5 = ValueListener(Elements=create_text_box_2, SomeProperty=True)  # -> Values, Indices
ghpython_script_4 = GhPythonScript(stPath=value_listener_5.Values)  # -> flatten(a)
# ---------- ghpython_script_4: Python ----------
__author__ = "DueringS"
__version__ = "2022.10.09"

import rhinoscriptsyntax as rs

a = "CD " + stPath
# ---------- end ghpython_script_4 ----------
merge = Merge(Data1=env, Data2=ghpython_script_4, Data3=script)
value_listener_6 = ValueListener(Elements=create_text_box_3, SomeProperty=True)  # -> flatten(Values), Indices
value_listener_7 = ValueListener(Elements=create_button, SomeProperty=True)  # -> Values, Indices
value_listener_8 = ValueListener(Elements=create_text_box, SomeProperty=True)  # -> Values, Indices
value_listener_9 = ValueListener(Elements=create_toggle, SomeProperty=True)  # -> flatten(Values), Indices
theshold = Slider(125.5, range=0..400)
data_dam = DataDam(DataDataA=value_listener_3.Values, BufferDelay=20000000, BufferMode=2)
data_dam_2 = DataDam(DataDataA=value_listener_2.Values, BufferDelay=20000000, BufferMode=2)
ghpython_script_5 = GhPythonScript(
    pxSize=data_dam_2,
    name=value_listener_8.Values,
    names=viewport_properties.ViewportNames,
    bds=viewport_properties.ViewportBounds)  # -> factor; inputs names: list, bds: list of Rectangle3d
# ---------- ghpython_script_5: Python ----------
__author__ = "DueringS"
__version__ = "2022.10.09"

import rhinoscriptsyntax as rs

for i, n in enumerate(names):
    if n == name:
        aa = pxSize / bds[i].Width
        factor = round(aa,1)
# ---------- end ghpython_script_5 ----------

# ---- group: toggle layer visibilitx
save_viewport_to_file = SaveViewportToFile(
    Run=value_listener_7.Values,
    ViewportName=value_listener_8.Values,
    Render=False,
    FilePath=concatenate,
    ScaleFactor=ghpython_script_5)
ghpython_script_6 = GhPythonScript(fp=concatenate, x=save_viewport_to_file)  # -> pOut
# ---------- ghpython_script_6: Python ----------
__author__ = "DueringS"
__version__ = "2022.10.14"

import rhinoscriptsyntax as rs
import Rhino.RhinoDoc as rhDoc
import scriptcontext as sc

sc.doc = rhDoc.ActiveDoc

rs.LayerVisible("MASK",False)
pOut= fp.replace(".png", "-B.png")
# ---------- end ghpython_script_6 ----------
save_viewport_to_file_2 = SaveViewportToFile(
    Run=value_listener_7.Values,
    ViewportName=value_listener_8.Values,
    Render=False,
    FilePath=ghpython_script_6,
    ScaleFactor=ghpython_script_5)
ghpython_script_7 = GhPythonScript(fp=concatenate, x=save_viewport_to_file_2)  # -> pOut
# ---------- ghpython_script_7: Python ----------
__author__ = "DueringS"
__version__ = "2022.10.14"

import rhinoscriptsyntax as rs
import Rhino.RhinoDoc as rhDoc
import scriptcontext as sc

sc.doc = rhDoc.ActiveDoc

rs.LayerVisible("MASK",True)
pOut= fp.replace(".png", "-B.png")
# ---------- end ghpython_script_7 ----------

# ---- group: preview anaconda command
tb = CreateTextBlock(Text="command", TextSize=12, Justification=0)
copytexttoclipboard = CSharpScript(x=flatten(merge), y=value_listener_4.Values)  # -> out, A; inputs x: list of String
# ---------- copytexttoclipboard: C# usings ----------
using System.Windows.Forms;
# ---------- copytexttoclipboard: C# ----------
    string newText = "";
    for (int i = 0; i < x.Count; i++)
    {
      newText += x[i];
      newText += System.Environment.NewLine;
    }
    System.Windows.Forms.Clipboard.SetText(newText);
    A = newText;
# ---------- end copytexttoclipboard ----------
settextblock = SetTextBlockContents(TextBlockToModify=tb, NewTextBlockContents=copytexttoclipboard.A)

# ----
ghpython_script_8 = GhPythonScript(prompt=value_listener_6.Values, txt=ghpython_script_2, state=value_listener_9.Values)  # -> a; inputs txt: list, state: list
# ---------- ghpython_script_8: Python ----------
__author__ = "DueringS"
__version__ = "2022.10.09"

import rhinoscriptsyntax as rs

promptFinal = prompt

for i, t in enumerate(txt):
    if state[i] == True:
        promptFinal += ", " + t

a = promptFinal
# ---------- end ghpython_script_8 ----------
create_color_picker = CreateColorPicker(DefaultColor=ColourSwatch(SwatchColor=RGB(252, 0, 0)))
create_slider_4 = CreateSlider(Slider=theshold, ShowBounds=False, ShowTicks=False, ShowTooltip=False, ShowValLabel=True, showLabel=True)
merge_2 = Merge(Data1=tb, Data2=create_button_2)
create_stack_2 = CreateStack(UIElements=merge_2, Horizontal=True)
value_listener_10 = ValueListener(Elements=create_color_picker, SomeProperty=True)  # -> Values, Indices
create_separator = CreateSeparator(Thickness=0.5, Horizontal=True, Color=RGB(0, 0, 0), Width=300, Height=20)
value_listener_11 = ValueListener(Elements=create_slider_4, SomeProperty=True)  # -> Values, Indices
loadbm = GhPythonScript(imgPath=save_viewport_to_file)  # -> bitmap
# ---------- loadbm: Python ----------
__author__ = "DueringS"
__version__ = "2021.08.19"

import rhinoscriptsyntax as rs
import System.Drawing.Bitmap as bm
import System.Drawing.Rectangle as Rectangle
import System.Drawing.Image as img
import System.IO.Stream as stream
import System.IO as sio
import base64
from clr import GetClrType as typeof
import System

bitmap = bm(imgPath)

converter = System.Drawing.ImageConverter()
bytes = converter.ConvertTo(bitmap, typeof(System.Array[System.Byte]))
imageB64 = System.Convert.ToBase64String(bytes,System.Base64FormattingOptions.None)

bitmap.Dispose()
bitmap = imageB64
# ---------- end loadbm ----------
loadbm_2 = GhPythonScript(imgPath=save_viewport_to_file_2)  # -> bitmap; same code as loadbm
adjust_element_positioning = AdjustElementPositioning(ElementsToAdjust=create_stack_2, AbsolutePositioning=False, HorizontalAlignment=1)
data_dam_3 = DataDam(DataDataA=value_listener_10.Values, BufferDelay=20000000, BufferMode=2)
data_dam_4 = DataDam(DataDataA=value_listener_11.Values, BufferDelay=20000000, BufferMode=2)
create_wrappanel = CreateWrapPanel(UIElements=create_toggle, Horizontal=True)
merge_3 = Merge(Data1=create_button)
c_script = CSharpScript(imgStr=loadbm_2)  # -> A
# ---------- c_script: C# usings ----------
using System.Drawing;
using System.Drawing.Drawing2D;
using System.Drawing.Imaging;
using System.IO;
using System.Linq;
# ---------- c_script: C# ----------
    
    string imgBS = imgStr as string;
    byte[] imageBytes = Convert.FromBase64String(imgBS);
    using (var imageStream = new MemoryStream(imageBytes, false))
    {
      Bitmap image = new Bitmap(imageStream);
       A = image;
    }
# ---------- end c_script ----------
merge_4 = Merge(Data2=create_slider_3, Data3=create_text_box, Data4=create_text_box_2, Data5=create_separator, Data6=create_stack_2)
c_script_2 = CSharpScript(imgStr=loadbm)  # -> A; same code as c_script
add_layer = AddLayer(Image=c_script_2, BlendMode=0, Opacity=1)
modify_layer = ModifyLayer(Layer=add_layer, Mode=11, Value=data_dam_4, Color=data_dam_3)
merge_layers = MergeLayers(Layers=modify_layer)
create_stack_3 = CreateStack(UIElements=merge_3, Horizontal=True)
create_view_box = CreateViewBox(UIElements=create_wrappanel, Width=350, Height=60)
image_to_bitmap = ImageToBitmap(Image=merge_layers, Loops=0)
image_to_bitmap_2 = ImageToBitmap(Image=c_script, Loops=0)

# ---- group: add iterations apram,
concatenate_3 = Concatenate(FragmentA="-s", FragmentB=value_listener.Values)
merge_5 = Merge(Data1=flatten(default_options), Data2=flatten(concatenate_3))

# ----
c_script_3 = CSharpScript(img=image_to_bitmap_2, img2=image_to_bitmap)  # -> out, A, B, C; inputs col: Color
# ---------- c_script_3: C# ----------
    Image image = img as Image;

    // color filter
    Image imgG = img2 as Image;


    float opacity = 0.01f;

    var colorMatrix = new ColorMatrix();
    colorMatrix.Matrix33 = opacity;
    var imageAttributes = new ImageAttributes();
    imageAttributes.SetColorMatrix(
      colorMatrix,
      ColorMatrixFlag.Default,
      ColorAdjustType.Bitmap);
    var output = new Bitmap(image.Width, image.Height);
    using (var gfx = Graphics.FromImage(output))
    {
      gfx.SmoothingMode = SmoothingMode.AntiAlias;
      gfx.DrawImage(
        image,
        new Rectangle(0, 0, image.Width, image.Height),
        0,
        0,
        image.Width,
        image.Height,
        GraphicsUnit.Pixel,
        imageAttributes);
    }
    A = output;

    Image tmp = (Image) output;
    B = tmp;
    C = imgG;
# ---------- end c_script_3 ----------
add_layer_2 = AddLayer(Image=c_script_3.A, BlendMode=0, Opacity=1)
add_layer_3 = AddLayer(Image=c_script_3.C, BlendMode=0, Opacity=1)
merge_6 = Merge(Data1=add_layer_3, Data2=add_layer_2)
panel = Panel(ghpython_script.b)
adjust_element_appearance = AdjustElementAppearance(ElementsToAdjust=merge_4, Foreground=RGB(0, 0, 0), Background=RGB(255, 255, 255), FontSize=12)
merge_layers_2 = MergeLayers(Layers=merge_6)
panel_2 = Panel("""model
settings
infill settings""")
merge_7 = Merge(Data1=create_slider_4, Data2=create_color_picker)
image_viewer = ImageViewer(Image=merge_layers_2)

# ---- group: ensure bitmap is disposed before trying to overwrite
merge_8 = Merge(Data1=c_script, Data2=c_script_2)
list_item_2 = ListItem(List=merge_8, Index=0, Wrap=True)
ghpython_script_9 = GhPythonScript(x=list_item_2, y=merge_layers_2)  # -> a
# ---------- ghpython_script_9: Python ----------
__author__ = "DueringS"
__version__ = "2022.10.14"

import rhinoscriptsyntax as rs

a = y
# ---------- end ghpython_script_9 ----------

# ---- group: ensure bitmap is disposed before trying to overwrite / dispose bitmap after use
loadbm_3 = GhPythonScript(bitmap=merge_8, x=merge_layers_2)  # -> a; disabled
# ---------- loadbm_3: Python ----------
__author__ = "DueringS"
__version__ = "2021.08.19"

import rhinoscriptsyntax as rs
import System.Drawing.Bitmap as bm
import System.Drawing.Rectangle as Rectangle
import System.Drawing.Image as img

bitmap.Dispose()
# ---------- end loadbm_3 ----------

# ----
ghpython_script_10 = GhPythonScript(fp="RhinoLive.png")  # -> pOut
# ---------- ghpython_script_10: Python ----------
__author__ = "DueringS"
__version__ = "2022.10.14"

import rhinoscriptsyntax as rs
import Rhino.RhinoDoc as rhDoc
import scriptcontext as sc


pOut= fp.replace(".png","B")
# ---------- end ghpython_script_10 ----------
panel_3 = Panel(ghpython_script_10)
export_bitmap = ExportBitmap(Image=ghpython_script_9, Path=panel, Name=panel_3, Extention=0, Save=True)
ghpython_script_11 = GhPythonScript(y=export_bitmap)  # -> flatten(a)
# ---------- ghpython_script_11: Python ----------
__author__ = "DueringS"
__version__ = "2022.10.11"

import rhinoscriptsyntax as rs
import random


a = int(random.randint(0,9999999))
# ---------- end ghpython_script_11 ----------
list_item_3 = ListItem(List=flatten(ghpython_script_11), Index=0, Wrap=True)
hops = Hops(
    _Path=concatenate_2,
    Prompt=ghpython_script_8,
    Seed=Slider(99, range=0..9999),
    ImgPath=export_bitmap,
    ModelOptions=merge_5,
    Strength=data_dam,
    HopsTrigger=list_item_3,
    CacheResultsInMemory=False,
    CacheSolveResults=False,
    RemoteDefinitionLocation="C:\Users\dueringS\ProjekteWS\StableDiffusion-Grasshopper\stableDiffusionSocket.gh",
    RemoteSolveVersion=(0, 1, 0),
    ShowInput_Enabled=False,
    ShowInput_Path=True,
    SynchronousSolve=False)
panel_4 = Panel(hops)

data_recorder = DataRecorder(hops, DataLimit=1, RecordData=True)
concatenate_4 = Concatenate(A=value_listener_5.Values, Fragment_A="\", Fragment_B=data_recorder)
create_image = CreateImage(ImageSource="asd", ImageWidth=600, ImageHeight=400)

set_image = SetImage(ImageToModify=create_image, NewImagePath=concatenate_4)
merge_9 = Merge(
    Data2=flatten(create_text_box_3),
    Data3=flatten(create_stack),
    Data4=flatten(create_view_box),
    Data5=flatten(create_image),
    Data6=flatten(merge_3))
tabbed_view = TabbedView(TabNames=panel_2, TabTextSize=12, Tab0=flatten(merge_9), Tab1=flatten(merge_4), Tab2=flatten(merge_7))

launch_window = LaunchWindow(Show=Toggle(True), Name="Stable Diffusion", Width=450, Height=600, ChildStatus=0, EnableHorizScroll=False)
add_elements = AddElements(Window=launch_window, Elements=flatten(tabbed_view), DoVLChecking=True)  # -> AddedElements, ElementNames

set_window_properties = SetWindowProperties(Window=launch_window, ShowTitleBar=Toggle(True), ScaleFactor=1)
loadbm_4 = GhPythonScript()  # -> bitmap
# ---------- loadbm_4: Python ----------
__author__ = "DueringS"
__version__ = "2021.08.19"

import rhinoscriptsyntax as rs
import System.Drawing.Bitmap as bm

bitmap = bm(imgPath)
# ---------- end loadbm_4 ----------
