# Grasshopper definition stableDiffusionSocket.gh (Grasshopper 1.0.7)

default_options = Panel("""-s50
-n1
-v0.5""")
prompt = GetString("a space cow is grazing on the moon", AtLeast=1, AtMost=2147483647)
seed = GetInteger(AtLeast=0, AtMost=1, Maximum=2147483647, Minimum=-2147483648)
imgpath = GetString(AtLeast=1, AtMost=2147483647)
modeloptions = GetString(default_options, AtLeast=1, AtMost=2147483647)
strength = GetNumber(Slider(0.5, range=0..1), AtLeast=1, AtMost=2147483647, Maximum=1.797693135e+308, Minimum=-1.797693135e+308)
hopstrigger = GetInteger(AtLeast=0, AtMost=1, Maximum=2147483647, Minimum=-2147483648, Prompt="add random number to force hops to recompute")
ghpython_script = GhPythonScript(prompt=prompt, seed=seed, filepath=imgpath, options=modeloptions, strength=strength, hopsTrigger=hopstrigger)  # -> path; inputs options: list
# ---------- ghpython_script: Python ----------
__author__ = "DueringS"
__version__ = "2021.10.15"

import rhinoscriptsyntax as rs
import socket
"""

conda activate ldm
cd C:\Users\dueringS\ProjekteWS\stable-diffusion
python scripts\dream.py --socket

"""
# SEND REQUEST TO UPDATE
# Set context
PORT = 5555
HOST = '127.0.0.1'


request = ''

# Set timeouts (otherwise GH will freeze when connection fails)
timeout = 1000

# Connect to server
print("Connecting to server...")



#send message to server
request +=  '"' +  _prompt + '"' +  " -I " +  _filepath

for opt in _options:
    request += " " + opt
if _seed != None:
    request = request + " --seed=" + str(_seed)
request = request + " --strength=" + str(_strength)

s = socket.socket(socket.AF_INET, socket.SOCK_STREAM)

s.connect((HOST,PORT))
s.sendall((str(request)))

print (request)
print('Sending request...')

path = s.recv(4024).decode()
# ---------- end ghpython_script ----------
context_print = ContextPrint(ImgPath=ghpython_script)
panel = Panel(ghpython_script)
data = Data("C:\Users\dueringS\ProjekteWS\GH_stableDiffusion\RhinoLive.png")
ghpython_script_2 = GhPythonScript()  # -> a
# ---------- ghpython_script_2: Python ----------
__author__ = "DueringS"
__version__ = "2022.10.05"

import rhinoscriptsyntax as rs
import time
b = time.time()
a = str(b)[5:]
print str(a)[5:]
# ---------- end ghpython_script_2 ----------
